# Grasshopper definition search_dse.gh (Grasshopper 1.0.7)
# plug-ins: Karamba3D, MetaHopper, Capture2, Sampler2, Reader, Sift, Pufferfish

design_id = Slider(0, range=0..2)

# ---- group: chosen ones
point = Point([Point(33.66042028, -8.992836925, -58), Point(37.49972488, 33.80943154, -58), Point(-6.118378112, 31.13358289, -58)])
number = Number(1.326314909)
curve = Curve([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])
point_2 = Point([Point(6.91650489, -28.32578781, 0), Point(22.57799013, -40.92310014, 0), Point(42.50836995, -41.97398522, 0), Point(60.74341204, -33.19060282, 0), Point(74.78769415, -18.67365103, 0), Point(81.29111008, 0.4554892412, 0)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])

# ----
curve_2 = Curve([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])
curve_3 = Curve([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])
curve_4 = Curve([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])
entwine = Entwine(Branch00=curve, Branch01=curve_3, Branch02=curve_2, FlattenInputs=True)  # -> simplify(Result)
remove_duplicate_lines_karamba3d = RemoveDuplicateLinesKaramba3D(Line=entwine, LimitDistance="0.00001")  # -> simplify(OutLine), Info, Indexes
tree_branch = TreeBranch(Tree=remove_duplicate_lines_karamba3d.OutLine, Path=design_id, MaintainPaths=True)

end_points = EndPoints(Curve=tree_branch)  # -> Start, End
remove_duplicate_points_karamba3d = RemoveDuplicatePointsKaramba3D(Point=[end_points.Start, end_points.End], LimitDistance=0.005)  # -> OutPoint, Info, Indexes

point_3 = Point(remove_duplicate_points_karamba3d.OutPoint)
deconstruct = Deconstruct(Point=point_3)  # -> XComponent, YComponent, ZComponent
sort_list = SortList(Keys=deconstruct.ZComponent, ValuesValuesA=point_3)  # -> Keys, ValuesValuesA
list_item = ListItem(List=sort_list.Keys, Index=0, Wrap=True)  # -> Item1, Item, Item1_2
subtraction = Subtraction(A=deconstruct.ZComponent, B=list_item.Item1)
absolute = Absolute(Value=subtraction)
smaller_than = SmallerThan(FirstNumber=absolute, SecondNumber="1e-5")  # -> SmallerThan, OrEqualTo
dispatch = Dispatch(List=point_3, DispatchPattern=smaller_than.SmallerThan)  # -> ListA, ListB
point_4 = Point(dispatch.ListA)

point_5 = Point(remove_duplicate_points_karamba3d.OutPoint)
deconstruct_2 = Deconstruct(Point=point_5)  # -> XComponent, YComponent, ZComponent
sort_list_2 = SortList(Keys=deconstruct_2.ZComponent, ValuesValuesA=point_5)  # -> Keys, ValuesValuesA
list_item_2 = ListItem(List=sort_list_2.Keys, Index=0, Wrap=True)  # -> Item1, Item, Item1_2
subtraction_2 = Subtraction(A=deconstruct_2.ZComponent, B=list_item_2.Item)
absolute_2 = Absolute(Value=subtraction_2)
smaller_than_2 = SmallerThan(FirstNumber=absolute_2, SecondNumber="1e-5")  # -> SmallerThan, OrEqualTo
dispatch_2 = Dispatch(List=point_5, DispatchPattern=smaller_than_2.SmallerThan)  # -> ListA, ListB
point_6 = Point(dispatch_2.ListA)

panel = Panel("""0.5
0.625
0.75
1""")
panel_2 = Panel("""0.25
0.3125
0.375
0.625""")
list_length = ListLength(List=panel_2)
list_length_2 = ListLength(List=panel)
duplicate_data = DuplicateData(Data="0.0625", Number=list_length, Order=True)
duplicate_data_2 = DuplicateData(Data="0.125", Number=list_length_2, Order=True)
merge = Merge(Data1=panel_2, Data2=panel)

# ---- group: kip to kN
multiplication = Multiplication(A="-0.001", B="4.448")

# ----
merge_2 = Merge(Data1=duplicate_data, Data2=duplicate_data_2)
kn_cm2 = Panel("207")
expression = Expression(x=merge, y=merge_2, Expression="Format(\"D-{0} x t-{1}\", x, y)")
kn_m_3 = Panel("12.7")
unit_z = UnitZ(Factor=multiplication)

# ---- group: in to cm
multiplication_2 = Multiplication(A=merge, B=2.54)

# ----
multiplication_3 = Multiplication(A=merge_2, B=2.54)
negative = Negative(Value="4.34")
division = Division(A=kn_cm2, B=2.5)
material_properties_karamba3d = MaterialPropertiesKaramba3D(
    FamilyOfMaterial="cellulose",
    Name="S235",
    YoungsModulus_kN_cm2=kn_cm2,
    InPlaneShearModulus_kN_cm2=division,
    TransverseShearModulus_kN_cm2=division,
    SpecificWeight_kip_ft3=kn_m_3,
    CoefficientOfThermalExpansion_1_F=6.666666667e-06,
    TensileStrength_kN_cm2="4.34",
    CompressiveStrength_kN_cm2=negative,
    StrengthHypothesis="MISES",
    mode="Isotrop")
cross_section_karamba3d = CrossSectionKaramba3D(
    FamilyNameOfCrossSection="DefaultCroSec",
    NameOfCrossSection=expression,
    Material=material_properties_karamba3d,
    Diameter_cm=multiplication_2,
    WallThickness_cm=multiplication_3,
    mode="Circular Hollow")
panel_3 = Panel(expression)
list_item_3 = ListItem(List=cross_section_karamba3d, Index=0, Wrap=True)
diameter_of_a_med_size_ball_m = Panel("0.038")
division_2 = Division(A=diameter_of_a_med_size_ball_m, B="2")
negative_2 = Negative(Value=division_2)
panel_4 = Panel("""3.26
4.00
4.69
10.13
0
0
0""")
use_opt_crosec = BooleanToggle(True)

# ---- group: Karamba plugin path (where karamba.dll is located)
panel_6 = Panel("C:\Users\harry\AppData\Roaming\McNeel\Rhinoceros\packages\7.0\Karamba3D\2.2.0.15")
panel_7 = Panel("C:\Program Files\Rhino 7\Plug-ins\Karamba")

# ---- group: Search control panel
maximal_displacement_tolerance_m = Slider(0.017, range=0..0.5)
maximal_stress_kn_cm2 = Slider(0.16, range=0..0.16)
objective = ValueList({"displacement", "stress"}, selected="displacement")
constraint = ValueList({"displacement", "stress"}, selected="displacement")
allowed_search_time_sec = Slider(300, range=0..30000)
optimize_method = ValueList({"feasible": "none", "optimal": "iterative_feasible_search", "diversity_search"}, selected="optimal")
heuristic = ValueList({"random", "z_distance", "graph_distance"}, selected="z_distance")
enable_search = BooleanToggle(False)
panel_8 = Panel(optimize_method)
panel_9 = Panel(heuristic)

# ----
plan_index = Slider(0, range=0..20)
ghpython_script = GhPythonScript(karamba_plugin_path=panel_6, objective=objective)  # -> out, test_stiffness_fn, compute_path_cost_fn
# ---------- ghpython_script: Python ----------
import math
##############################
import os
import clr
# https://ironpython.net/documentation/dotnet/dotnet.html

clr.AddReferenceToFileAndPath(os.path.join(karamba_plugin_path, "Karamba.gha"))
clr.AddReferenceToFileAndPath(os.path.join(karamba_plugin_path, "KarambaCommon.dll"))

import KarambaCommon
import Karamba.Models.Model as Model
import Karamba.GHopper.Models.GH_Model as GH_Model
import Karamba.Elements.ModelTruss as Truss
import Karamba.Elements.ModelBeam as Beam
import Karamba.Materials.FemMaterial_Isotrop as FemMaterial
from Karamba.Results import BeamResultantForces, BeamForces
from Karamba.Results import Utilization_Beam, UtilizationResults_Beam
import feb # Karamba's C++ library (undocumented in the API)
#import System.GC as GC
from System.Collections.Generic import List
from System import Guid

##############################

def compute_path_cost(plan):
    return max([abs(max_disp if objective=='displacement' else max_stress) \
        for _, (max_disp, max_stress) in plan])

def test_stiffness(model_in, existing_e_ids, lc=0, verbose=False):
    if not existing_e_ids:
        return True
    
    # clone the model and its list of elements to avoid side effects
    model = model_in.Clone()
    # clone its elements to avoid side effects
    model.cloneElements()
    # clone the feb-model to avoid side effects
    model.deepCloneFEModel()
    
    for e in model.elems:
        e.set_is_active(model, e.ind in existing_e_ids)
    
    deform = feb.Deform(model.febmodel)
    response = feb.Response(deform)
    
    try:
        # calculate the displacements
        response.updateNodalDisplacements();
        # calculate the member forces
        response.updateMemberForces();
    except:
        raise ValueError("The stiffness matrix of the system is singular.")
        
    # if something changed inform the feb-model about it (otherwise it won't recalculate)
    model.febmodel.touch()
    
    # * Computing max displacement
    max_disp = -10e-5
    for i in range(len(model.nodes)):
        node_x = model.febmodel.state(0).nodeState(i).disp_trans_global().x()
        node_y = model.febmodel.state(0).nodeState(i).disp_trans_global().y()
        node_z = model.febmodel.state(0).nodeState(i).disp_trans_global().z()
        n_disp = math.sqrt(node_x**2 + node_y**2 + node_z**2)
        if n_disp > max_disp:
            max_disp = n_disp
    
    # * Computing max stress
    lc = 0
    # no extra identifier allowed for now
    elem_id = ''
    assert len(model.elementsByID(List[str]([elem_id]))) == len(model.elems)
    # number of sampling points along beams
    samplingPointsCount = 5;
    # elastic or plastic cross section design?
    isElasticDesign = True;
    # material safety factor is buckling does not govern the design
    gammaM0 = 1.0;
    # material safety factor is buckling does govern the design
    gammaM1 = 1.1;
    # does buckling involve sideways sway?
    swayFrame = False;
    # shall the output contain calculation details?
    withDetails = False;
    
    max_disp2 = clr.Reference[List[float]]()
    out_g = clr.Reference[List[float]]()
    out_comp = clr.Reference[List[float]]()
    message = clr.Reference[str]()
    k3d = KarambaCommon.Toolkit();
    model = k3d.Algorithms.AnalyzeThI(model, 
        max_disp2, out_g, out_comp, message);
    
    # resulting beam utilizations
    modelUtil = clr.Reference[UtilizationResults_Beam]()
    # resulting message
    message = clr.Reference[str]()
    
    Utilization_Beam.solve(
      model,
      List[str](['']),
      List[Guid]([]),
      str(lc),
      samplingPointsCount,
      isElasticDesign,
      gammaM0,
      gammaM1,
      swayFrame,
      withDetails,
      modelUtil,
      message);
    
    max_sigma = -10e-5
    for i in existing_e_ids: # range(len(model.elems)):
        esigmax = max([abs(modelUtil.sig_max[i]), abs(modelUtil.sig_min[i])])
        if max_sigma < esigmax:
            max_sigma = esigmax
    
    return max_disp, max_sigma
    
##########################
test_stiffness_fn = test_stiffness
compute_path_cost_fn = compute_path_cost
# ---------- end ghpython_script ----------
match_text = MatchText(Text=constraint, Pattern="stress", Case=True)
stream_filter = StreamFilter(Gate=match_text, Stream0=maximal_displacement_tolerance_m, Stream1=maximal_stress_kn_cm2)
check_stiffness_constraint = BooleanToggle(True)
save_solutions = BooleanToggle(True)
concatenate = Concatenate(Fragment_A="runtime_tol:", Fragment_B=allowed_search_time_sec, A="s")
panel_10 = Panel(concatenate)
solution_bundle_index = Slider(0, range=0..4)

# ---- group: Make save path
text = Text(heuristic)
stream_filter_2 = StreamFilter(Gate=check_stiffness_constraint, Stream0="no_stiffness", Stream1=text)
concatenate_2 = Concatenate(FragmentA="CM_", FragmentB=stream_filter_2)
ghpython_script_2 = GhPythonScript(
    objective=objective,
    constraint=constraint,
    physical_tol=stream_filter,
    timeout=allowed_search_time_sec,
    optimize=optimize_method,
    tag=concatenate_2)  # -> out, filename
# ---------- ghpython_script_2: Python ----------
tol_setup = '{}-tol={:.4f}'.format(constraint, physical_tol)
filename = "min_{}_st_{}_timeout={}_opt-alg={}_{}".format(
    objective, tol_setup, timeout, optimize, tag or '')
# ---------- end ghpython_script_2 ----------
panel_11 = Panel(ghpython_script_2.filename)
rhino_doc_dir = RhinoDocDir()  # -> rhino_doc_dir
# ---------- rhino_doc_dir: Python ----------
import scriptcontext as sc
from os import path

rhino_doc_dir = path.abspath(path.dirname(sc.doc.Path))
# ---------- end rhino_doc_dir ----------
text_2 = Text(ghpython_script_2.filename)
concatenate_3 = Concatenate(Fragment_A=rhino_doc_dir, Fragment_B="dse_samples", A=text_2, JoinSeparator="//")
create_dir_set = BooleanToggle(True)
pathmaker = GhPythonScript(path=concatenate_3, on=create_dir_set)  # -> out, a
# ---------- pathmaker: Python ----------
import os

if on:
    if not os.path.exists(path):
        os.mkdir(path)
a = os.path.abspath(path)
# ---------- end pathmaker ----------
panel_12 = Panel(pathmaker.a)

# ---- group: solution path
text_3 = Text(pathmaker.a)
number_2 = Number(design_id)
ghpython_script_3 = GhPythonScript(path=text_3, x=number_2)  # -> out, a; inputs x: list
# ---------- ghpython_script_3: Python ----------
import os
dir_name = 'x={}{}'.format('_'.join(map(lambda t: '{:.2f}'.format(t), x)), tag or '')
a = os.path.join(path, dir_name)
# ---------- end ghpython_script_3 ----------

# ----
panel_13 = Panel(ghpython_script_3.a)

# ---- group: For making a gif of the sequence
panel_14 = Panel("stress")
integer = Integer(solution_bundle_index)
panel_15 = Panel("sol")
concatenate_4 = Concatenate(FragmentD=ghpython_script_3.a, FragmentA="displacement", FragmentC="opt_sol", FragmentB=integer, JoinSeparator="_")
panel_16 = Panel("black_bars")

# ----
text_4 = Text(pathmaker.a)
control_wire_display = ControlWireDisplay(
    WireDisplay=Slider(1, range=0..2),
    AllObjects_Object=[selected_design_id, ghpython_script_7, panel_34, file_path_4, integer_6, save_fig_2, integer_5, file_path_5, restart_2, text_8, black_background_2])
ghpython_script_4 = GhPythonScript(karamba_plugin_path=panel_6)  # -> out, test_stiffness_fn, compute_path_cost_fn
# ---------- ghpython_script_4: Python ----------
import math
##############################
import os
import clr
# https://ironpython.net/documentation/dotnet/dotnet.html

clr.AddReferenceToFileAndPath(os.path.join(karamba_plugin_path, "Karamba.gha"))
clr.AddReferenceToFileAndPath(os.path.join(karamba_plugin_path, "KarambaCommon.dll"))

import KarambaCommon
import Karamba.Models.Model as Model
import Karamba.GHopper.Models.GH_Model as GH_Model
import Karamba.Elements.ModelTruss as Truss
import Karamba.Elements.ModelBeam as Beam
import Karamba.Materials.FemMaterial_Isotrop as FemMaterial
from Karamba.Results import BeamResultantForces, BeamForces
from Karamba.Results import Utilization_Beam, UtilizationResults_Beam
import feb # Karamba's C++ library (undocumented in the API)
#import System.GC as GC
from System.Collections.Generic import List
from System import Guid

##############################

def test_stiffness(model_in, existing_e_ids, lc=0, verbose=False):
    if not existing_e_ids:
        return True
    
    # clone the model and its list of elements to avoid side effects
    model = model_in.Clone()
    # clone its elements to avoid side effects
    model.cloneElements()
    # clone the feb-model to avoid side effects
    model.deepCloneFEModel()
    
    for e in model.elems:
        e.set_is_active(model, e.ind in existing_e_ids)
    
    deform = feb.Deform(model.febmodel)
    response = feb.Response(deform)
    
    try:
        # calculate the displacements
        response.updateNodalDisplacements();
        # calculate the member forces
        response.updateMemberForces();
    except:
        raise ValueError("The stiffness matrix of the system is singular.")
        
    # if something changed inform the feb-model about it (otherwise it won't recalculate)
    model.febmodel.touch()
    
    # * compute displacement
    max_disp = -10e-5
    for i in range(len(model.nodes)):
        node_x = model.febmodel.state(0).nodeState(i).disp_trans_global().x()
        node_y = model.febmodel.state(0).nodeState(i).disp_trans_global().y()
        node_z = model.febmodel.state(0).nodeState(i).disp_trans_global().z()
        n_disp = float(math.sqrt(node_x**2 + node_y**2 + node_z**2))
        if n_disp > max_disp:
            max_disp = n_disp
            
    # * compute stress
    lc = 0
    # no extra identifier allowed for now
    elem_id = ''
    assert len(model.elementsByID(List[str]([elem_id]))) == len(model.elems)
    # number of sampling points along beams
    samplingPointsCount = 5;
    # elastic or plastic cross section design?
    isElasticDesign = True;
    # material safety factor is buckling does not govern the design
    gammaM0 = 1.0;
    # material safety factor is buckling does govern the design
    gammaM1 = 1.1;
    # does buckling involve sideways sway?
    swayFrame = False;
    # shall the output contain calculation details?
    withDetails = False;
    
    _max_disp = clr.Reference[List[float]]()
    out_g = clr.Reference[List[float]]()
    out_comp = clr.Reference[List[float]]()
    message = clr.Reference[str]()
    k3d = KarambaCommon.Toolkit();
    computed_model = k3d.Algorithms.AnalyzeThI(model, 
        _max_disp, out_g, out_comp, message);
    
    # resulting beam utilizations
    modelUtil = clr.Reference[UtilizationResults_Beam]()
    # resulting message
    message = clr.Reference[str]()
    
    Utilization_Beam.solve(
      computed_model,
      List[str](['']),
      List[Guid]([]),
      str(lc),
      samplingPointsCount,
      isElasticDesign,
      gammaM0,
      gammaM1,
      swayFrame,
      withDetails,
      modelUtil,
      message);
    
    max_sigma = -10e-5
    for i in existing_e_ids: # range(len(model.elems)):
        esigmax = float(max([abs(modelUtil.sig_max[i]), abs(modelUtil.sig_min[i])]))
        if max_sigma < esigmax:
            max_sigma = esigmax
            
    return max_disp, max_sigma

def compute_path_cost(plan):
    return max([abs(max_disp) for _, max_disp in plan])

##########################
test_stiffness_fn = test_stiffness
compute_path_cost_fn = compute_path_cost
# ---------- end ghpython_script_4 ----------
cube = Cube(Value=Slider(6, range=0..10))
# Set the sequence step to max!
boolean = Boolean(Toggle(False))
compute_fea_for_seq = BooleanToggle(True)
file_path = FilePath(text_3)
save_fig = BooleanToggle(True)
restart = BooleanToggle(True)

# ---- group: karamba model path
text_5 = Text()

# ----
text_6 = Text(text_2)
black_background = BooleanToggle(False)
integer_2 = Integer(solution_bundle_index)

# ---- group: Visualization panel
sequence_step = Slider(213, range=1..214)

# ----
get_connected_objects = GetConnectedObjects(Objects=sequence_step)
series = Series(Start="15", Step="15", Count="6")
panel_17 = Panel(series)

# ---- group: in [cm]
point_7 = Point(point_6)
number_3 = Number(1.326314909)
curve_5 = Curve(tree_branch)
point_8 = Point(point_4)
scale = Scale(Geometry=point_8, Center=Point(0, 0, 0), Factor=number_3)  # -> Geometry, Transform
scale_2 = Scale(Geometry=point_7, Center=Point(0, 0, 0), Factor=number_3)  # -> Geometry, Transform

# ----
settings_karamba3d = SettingsKaramba3D(GenericInput=curve_5, menu=[dropdown(0)])  # -> port, GenericOutput

# ---- group: in [cm] (continued)
scale_3 = Scale(Geometry=settings_karamba3d.GenericOutput, Center=Point(0, 0, 0), Factor=number_3)  # -> Geometry, Transform

# ----
scale_4 = Scale(Geometry=scale.Geometry, Center=Point(0, 0, 0), Factor="0.01")  # -> Geometry, Transform
scale_5 = Scale(Geometry=scale_2.Geometry, Center=Point(0, 0, 0), Factor="0.01")  # -> Geometry, Transform
scale_6 = Scale(Geometry=scale_3.Geometry, Center=Point(0, 0, 0), Factor="0.01")  # -> Geometry, Transform
curve_6 = Curve(scale_6.Geometry)
bounding_box_dimension = BoundingBoxDimension(content=curve_6)  # -> result, result_2, result_3
list_indices = ListIndices(List=curve_6)
panel_18 = Panel([bounding_box_dimension.result, bounding_box_dimension.result_2, bounding_box_dimension.result_3])
concatenate_5 = Concatenate(FragmentA="E", FragmentB=list_indices)
list_length_3 = ListLength(List=curve_6)
support_karamba3d = SupportKaramba3D(PosInd=scale_5.Geometry, menu=[buttons(on, on, on, on, on, on)])
curve_7 = Curve(curve_6)
line_to_beam_karamba3d = LineToBeamKaramba3D(
    Line=curve_6,
    Identifier=concatenate_5,
    New=True,
    Remove=True,
    LimitDistance_cm=0.005,
    Bending=True,
    SetBucklingLength=True,
    ToPolylineMaxAngle=0.03,
    ToPolylineTolerance=0.01,
    ToPolylineMinEdgeLength=0.25)  # -> Element, Points, Info

loads_karamba3d = LoadsKaramba3D(ForceVector=unit_z, Local=False, PosInd=scale_4.Geometry, LCase="0", mode="Point")
loads_karamba3d_2 = LoadsKaramba3D(Vector=Vector(0, 0, -1), LCase="0", mode="Gravity")

concatenate_6 = Concatenate(FragmentA="E#", FragmentB=list_length_3)
e_num = Panel(concatenate_6)
support_karamba3d_2 = SupportKaramba3D(support_karamba3d)
assemble_model_karamba3d = AssembleModelKaramba3D(
    Elem=line_to_beam_karamba3d.Element,
    Support=support_karamba3d,
    Load=flatten([loads_karamba3d, loads_karamba3d_2]),
    CrossSection=list_item_3,
    Material=material_properties_karamba3d,
    LimitDistance_m=0.005)  # -> Model, Info, Mass_lbm, CenterOfGravity, LoadCaseNames
analyze_karamba3d = AnalyzeKaramba3D(Model=assemble_model_karamba3d.Model)  # -> CalculatedModel, MaximumDisplacement_in, ResultingForceOfGravity_kip, ElasticEnergyChange_kip_ft
optimize_cross_section_karamba3d = OptimizeCrossSectionKaramba3D(
    Model=analyze_karamba3d.CalculatedModel,
    CrossSections=cross_section_karamba3d,
    MaximumUtilization=1,
    UltimateLimitStateIterations=5,
    DisplacementIterations=5,
    NumberOfSamplePoints=3,
    ElasticDesign=True,
    GammaM0=1,
    GammaM1="1.5",
    SwayFrame=True)  # -> ModelWithOptimizedCrossSections, Info, Mass_lbm, MaximumDisplacement_in, ElasticEnergyChange_kip_ft
panel_19 = Panel(analyze_karamba3d.MaximumDisplacement_in)
disassemble_model_karamba3d = DisassembleModelKaramba3D(Model=optimize_cross_section_karamba3d.ModelWithOptimizedCrossSections)  # -> Model, Point, Beam, Shell, Support, Load, Line, Mesh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
panel_20 = Panel(optimize_cross_section_karamba3d.MaximumDisplacement_in)
panel_21 = Panel(optimize_cross_section_karamba3d.Mass_lbm)
curve_8 = Curve(curve_6)
disassemble_element_karamba3d = DisassembleElementKaramba3D(Element=disassemble_model_karamba3d.Beam)  # -> Element, ElementIdentifier, AxisOfElement, CrossSection, Joint, Material, LocalCoordinateSystem, ElementIsActive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
extend_curve = ExtendCurve(Curve=curve_8, Type=0, Start=negative_2, End=negative_2)
modify_cross_section_karamba3d = ModifyCrossSectionKaramba3D(
    CroSec=graft(disassemble_element_karamba3d.CrossSection),
    ElementIdentifiers=graft(disassemble_element_karamba3d.ElementIdentifier),
    mode="Beam")  # -> flatten(CrossSection)
length = Length(Curve=extend_curve)
bar_graph = BarGraph(length, BarColor=RGB(255, 0, 90))
disassemble_cross_section_karamba3d = DisassembleCrossSectionKaramba3D(CroSec=modify_cross_section_karamba3d)  # -> CrossSection, FamilyNameOfCrossSection, TypeNameOfCrossSection, ElemIdentifiers, Color, Material, LocalEccentricity_in, flatten(Heights_in)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
member_index = MemberIndex(Set=disassemble_cross_section_karamba3d.TypeNameOfCrossSection, Member=expression)  # -> Index, Count
list_item_4 = ListItem(List=length, Index=member_index.Index, Wrap=True)
mass_addition = MassAddition(Input=list_item_4)  # -> flatten(Result), PartialResults
panel_22 = Panel(member_index.Count)
clean_tree = CleanTree(RemoveNulls=True, RemoveInvalid=True, RemoveEmpty=False, Tree=mass_addition.Result)
sort_list_3 = SortList(Keys=length)  # -> Keys, ValuesValuesA
multiplication_4 = Multiplication(A=clean_tree, B="100")
total_length_cm = Panel(multiplication_4)
division_3 = Division(A=total_length_cm, B=2.54)
division_4 = Division(A=division_3, B=72)
cross_section_karamba3d_2 = CrossSectionKaramba3D(disassemble_cross_section_karamba3d.CrossSection)
round = Round(Number=division_4)  # -> Nearest, Floor, Ceiling
multiplication_5 = Multiplication(A=round.Ceiling, B=panel_4)

# ---- group: reassemble the karamba model so the cross section are assigned to elements correctly
assemble_model_karamba3d_2 = AssembleModelKaramba3D(
    Elem=line_to_beam_karamba3d.Element,
    Support=support_karamba3d,
    Load=flatten(loads_karamba3d_2),
    CrossSection=cross_section_karamba3d_2,
    Material=material_properties_karamba3d,
    LimitDistance_m=0.005)  # -> Model, Info, Mass_lbm, CenterOfGravity, LoadCaseNames

# ----
panel_23 = Panel(round.Ceiling)
panel_24 = Panel(multiplication_5)
mass_addition_2 = MassAddition(Input=panel_24)  # -> Result, PartialResults
panel_25 = Panel(mass_addition_2.Result)
analyze_karamba3d_2 = AnalyzeKaramba3D(Model=assemble_model_karamba3d_2.Model)  # -> CalculatedModel, MaximumDisplacement_cm, ResultingForceOfGravity_kN, ElasticEnergyChange_kNm

# ---- group: w crossec opt
model_karamba3d = ModelKaramba3D(assemble_model_karamba3d_2.Model)

# ---- group: wo crossec opt
model_karamba3d_2 = ModelKaramba3D(analyze_karamba3d.CalculatedModel)

# ----
stream_filter_3 = StreamFilter(Gate=use_opt_crosec, Stream0=model_karamba3d_2, Stream1=model_karamba3d)
model_view_karamba3d = ModelViewKaramba3D(Model=analyze_karamba3d_2.CalculatedModel, ResultFactors=1, ResultCase=-1)  # -> Model, DeformedMesh, DeformedAxes, DeformedModel; disabled
model_karamba3d_3 = ModelKaramba3D(stream_filter_3)
support_karamba3d_3 = SupportKaramba3D(support_karamba3d_2)
beam_view_karamba3d = BeamViewKaramba3D(Model=model_view_karamba3d.Model)  # -> Model, MeshesOfRenderedBeams, DeformedBeamAxes, LegendColors, LegendTags; disabled
legend = Legend(Colour=beam_view_karamba3d.LegendColors, Tags=beam_view_karamba3d.LegendTags, LegendType=1)  # disabled

# ---- group: mass
number_4 = Number(flatten(assemble_model_karamba3d_2.Mass_lbm))

# ---- group: number of elements
integer_3 = Integer(list_length_3)

# ---- group: file path for saving/parsing plans
file_path_2 = FilePath(ghpython_script_3.a)
text_7 = Text(pathmaker.a)
use_sifted_path = BooleanToggle(False)
concatenate_7 = Concatenate(FragmentA=file_path_2, FragmentB="_seq_solution_bundles.json")

# ---- group: solution path
file_path_3 = FilePath(concatenate_7)

# ---- group: set num of solutions range
get_connected_objects_2 = GetConnectedObjects(Objects=solution_bundle_index)

# ---- group: color coded seq viz
list_length_4 = ListLength(List=curve_6)
division_5 = Division(A=disassemble_cross_section_karamba3d.Heights_in, B=2)
integer_4 = Integer(list_length_4)
ghpython_script_5 = GhPythonScript(nE=integer_4)  # -> out, simplify(colors); inputs nE: Int32
# ---------- ghpython_script_5: Python ----------
from itertools import combinations

import System
import Grasshopper.Kernel.Data.GH_Path as ghpath
import Grasshopper.DataTree as datatree

from ghpythonlib.treehelpers import list_to_tree, tree_to_list

#from compas_ghpython import unload_modules
#unload_modules("coop_assembly")

from compas.rpc import Proxy
cp_v = Proxy('seq_dse.visualization') #, python='python', capture_output=False)

colors = cp_v.sample_colors(nE)
colors = list_to_tree(colors, source=[])
# ---------- end ghpython_script_5 ----------
multiplication_6 = Multiplication(A=division_5, B=0.01)
list_item_5 = ListItem(List=ghpython_script_5.colors, Index=0, Wrap=True)  # -> Item, Item1, Item2
pipe = Pipe(Curve=curve_6, Radius=multiplication_6, Caps=0)  # -> flatten(Pipe)
colour_rgb_f = ColourRGBF(Alpha=1, Red=list_item_5.Item, Green=list_item_5.Item1, Blue=list_item_5.Item2)  # -> flatten(Colour)
colour = Colour(colour_rgb_f)

# ---- group: For making a gif of the sequence
# Example script for making a gif: convert -delay 100 -loop 0 *.png interpolant.gif
panel_26 = Panel("convert -delay 100 -loop 0")  # disabled
panel_27 = Panel("\*.png")  # disabled
panel_28 = Panel("_interpolant.gif")  # disabled
panel_29 = Panel(" ")  # disabled
panel_30 = Panel("\..\")  # disabled
panel_31 = Panel("\"")  # disabled
run_gif_make = Button()  # disabled

# ---- group: Exporting the displacement/stress graph using matplotlib, requires a compas.rpc setup
selected_design_id = Slider(0, range=0..10)  # disabled
file_path_4 = FilePath(text_3)  # disabled
save_fig_2 = BooleanToggle(False)  # disabled
restart_2 = BooleanToggle(False)  # disabled
black_background_2 = BooleanToggle(False)  # disabled
text_8 = Text(text_2)  # disabled
integer_5 = Integer(solution_bundle_index)  # disabled
integer_6 = Integer(selected_design_id)  # disabled

# ----
integer_7 = Integer(selected_design_id)

# ---- group: For making a gif of the sequence
create_dir = BooleanToggle(True)
concatenate_8 = Concatenate(FragmentB="seq")
pathmaker_2 = GhPythonScript(path=concatenate_4, subdir=panel_16, on=create_dir)  # -> out, a
# ---------- pathmaker_2: Python ----------
import os

path = os.path.join(path,subdir)
if on:
    if not os.path.exists(path):
        os.mkdir(path)
a = os.path.abspath(path)
# ---------- end pathmaker_2 ----------
panel_32 = Panel(concatenate_8)

concatenate_9 = Concatenate(
    FragmentA=panel_26,
    FragmentH=panel_29,
    FragmentG=panel_31,
    FragmentA_2=pathmaker_2.a,
    FragmentB=panel_27,
    FragmentE=panel_31,
    FragmentF=panel_29,
    FragmentD=panel_31,
    FragmentJ=pathmaker_2.a,
    FragmentB_2=panel_28,
    FragmentI=panel_31)  # disabled
panel_33 = Panel(concatenate_9)  # disabled
ghpython_script_6 = GhPythonScript(run=run_gif_make, command=panel_33)  # -> out, a; disabled
# ---------- ghpython_script_6: Python ----------
import subprocess

if run:
    subprocess.call(command, shell=True)
# ---------- end ghpython_script_6 ----------

# ---- group: Exporting the displacement/stress graph using matplotlib, requires a compas.rpc setup (continued)
file_path_5 = FilePath(pathmaker_2.a)  # disabled
panel_34 = Panel(file_path_5)  # disabled
ghpython_script_7 = GhPythonScript(
    save=save_fig_2,
    restart=restart_2,
    data_path=file_path_5,
    test_folder_name=text_8,
    design_id=integer_6,
    seq_id=integer_5,
    black_background=black_background_2)  # -> out, simplify(colors); inputs save: Boolean, design_id: Int32, seq_id: Int32, seq: list of Int32, stress_history: list, displacement_history: list, black_background: Boolean; disabled
# ---------- ghpython_script_7: Python ----------
from itertools import combinations

import System
import Grasshopper.Kernel.Data.GH_Path as ghpath
import Grasshopper.DataTree as datatree

from ghpythonlib.treehelpers import list_to_tree, tree_to_list

assert len(stress_history)>100
if save:
    from compas.rpc import Proxy
    with Proxy('seq_dse.visualization') as cp_v: #, python='python', capture_output=False)
        if restart:
            cp_v.restart_server()
        cp_v.save_seq_performance_plot(data_path, test_folder_name, design_id, seq_id,
         seq, stress_history, displacement_history, black_background=black_background)
# ---------- end ghpython_script_7 ----------
panel_35 = Panel(ghpython_script_7.out)  # disabled

# ----
panel_36 = Panel(pathmaker_2.a)
file_path_6 = FilePath(pathmaker_2.a)
panel_37 = Panel(file_path_6)

panel_38 = Panel("""1
2""")
number_5 = Number(simplify(graft(panel_38)))
panel_39 = Panel(number_5)
panel_40 = Panel(cube)
sampler = Sampler(Samples=panel_40, Type=1, Seed="123", Directory="None")  # -> DesignMap, Data; disabled
text_9 = Text()
ghpython_script_8 = GhPythonScript(x=text_5)  # -> out, a
# ---------- ghpython_script_8: Python ----------
import os
a = os.path.basename(x)
# ---------- end ghpython_script_8 ----------
ghpython_script_9 = GhPythonScript(x=file_path_3)  # -> out, a; same code as ghpython_script_8
merge_3 = Merge(Data1=ghpython_script_8.a, Data2=ghpython_script_9.a, Data3=text_9)
panel_41 = Panel(merge_3)

# ---- group: Parse solutions
list_length_5 = ListLength(List=design_id)
number_slider = Slider(0, range=0..1)
concatenate_10 = Concatenate(Fragment_A=text_4, Fragment_B="\", A="samples", B=".csv")
get_connected_objects_3 = GetConnectedObjects(Objects=number_slider)
reader = Reader(Filepath=concatenate_10, Separator=",")
tree_statistics = TreeStatistics(Tree=reader)  # -> Paths, Length, Count
subtraction_3 = Subtraction(A=tree_statistics.Count, B=1)
split_list = SplitList(List=reader, Index=list_length_5)  # -> simplify(ListA), ListB
sift = Sift(Variables=design_id, DesignMap=split_list.ListA, Index=number_slider)
construct_domain = ConstructDomain(DomainStart="0", DomainEnd=subtraction_3)
tree_branch_2 = TreeBranch(Tree=reader, Path=number_slider, MaintainPaths=True)
set_slider_properties = SetSliderProperties(Slider=get_connected_objects_3, Range=construct_domain)
list_item_6 = ListItem(List=tree_branch_2, Index="4", Wrap=True)
list_item_7 = ListItem(List=tree_branch_2, Index="5", Wrap=True)
panel_42 = Panel(tree_branch_2)
panel_43 = Panel(list_item_6)

# ---- group: file path for saving/parsing plans (continued)
text_10 = Text(list_item_7)
concatenate_11 = Concatenate(FragmentA=text_7, FragmentA_2=text_10, JoinSeparator="\")
stream_filter_4 = StreamFilter(Gate=use_sifted_path, Stream0=concatenate_7, Stream1=concatenate_11)
panel_44 = Panel(stream_filter_4)

# ----
progression_search_algorithm = GhPythonScript(
    enable=enable_search,
    test_stiffness_fn=ghpython_script.test_stiffness_fn,
    compute_path_cost_fn=ghpython_script.compute_path_cost_fn,
    Model_in=model_karamba3d_3,
    grounded_supports=support_karamba3d_3,
    verbose=False,
    objective=objective,
    constraint=constraint,
    physical_tol=stream_filter,
    check_stiffness=check_stiffness_constraint,
    heuristic=heuristic,
    max_time=allowed_search_time_sec,
    optimize_method=optimize_method,
    use_two_link_prune=True,
    random_tiebreak=False,
    save_solutions=save_solutions,
    iter_search_eps="0.0001",
    save_path=stream_filter_4)  # -> out, solution_bundles; inputs grounded_supports: list, verbose: Boolean, check_stiffness: Boolean, partial_orders: tree of Int32, use_two_link_prune: Boolean, random_tiebreak: Boolean
# ---------- progression_search_algorithm: Python ----------
# The much of the code in the sequencing part is adapted from https://github.com/caelan/pb-construction

import Rhino.Geometry.Point3d as Point3d
import Grasshopper.DataTree as DataTree # Add, AddRange(list, GHPath(i, j))
import Grasshopper.Kernel.Data.GH_Path as GHPath
import System

from ghpythonlib.treehelpers import list_to_tree, tree_to_list

##############################

import heapq
import json
import random
import time
import math
import copy
from collections import namedtuple, OrderedDict, defaultdict, deque

INF = 1e12
DEFAULT_PHYSICAL_TOL = 5e-2 # meter

SEARCH_HEURISTIC = {
    'random', 'z_distance', 'graph_distance',
}
OPTIMIZE_METHODS = {
    'none', 'iterative_feasible_search', 'diversity_search',
}

class SeqSolution(object):
    def __init__(self, seq, stepwise_physics_performance, cost, seq_id_map=None, search_info=None):
        if seq_id_map is not None:
            self.seq = [seq_id_map[s] for s in seq]
        else:
            self.seq = seq
        self.stepwise_physics_performance = stepwise_physics_performance
        self.cost = cost
        self.search_info = search_info or {}

    def to_data(self):
        return {
            'seq' : self.seq,
            'stepwise_physics_performance' : self.stepwise_physics_performance,
            'cost' : self.cost,
            'search_info' : self.search_info,
        }

    @classmethod
    def from_data(cls, data):
        return cls(data['seq'],data['stepwise_physics_performance'],data['cost'],search_info=data['search_info'])

class SeqSolutionBundle(object):
    def __init__(self, solutions, search_info=None):
        self.solutions = solutions or []
        self.search_info = search_info or {}

    def to_data(self):
        return {
            'solutions' : [sol.to_data() for sol in self.solutions],
            'search_info' : self.search_info,
        }

    @classmethod
    def from_data(cls, data):
        return cls([SeqSolution.from_data(sd) for sd in data['solutions']], data['search_info'])

    @property
    def feasible_found(self):
        return len(self.solutions) > 0

    @property
    def sorted_solutions(self):
        return sorted(self.solutions, key=lambda sol: sol.cost)

    @property
    def best_solution(self):
        if len(self.solutions) > 0:
            return self.sorted_solutions[0]
        else:
            return None

    @property
    def costs(self):
        return [s.cost for s in self.solutions]

    @property
    def min_cost(self):
        if self.costs:
            return min(self.costs)
        else:
            return None

    def __repr__(self):
        return 'Bundle: {} solutions, best cost {}'.format(len(self.solutions), self.min_cost)

##############################

def randomize(iterable):
    sequence = list(iterable)
    random.shuffle(sequence)
    return sequence
    
def elapsed_time(start_time):
    return time.time() - start_time

##############################

def load_model(model, grounded_supports):
    # load connectivity data from karamba model
    element_from_id = OrderedDict((e.ind, tuple(e.node_inds)) for e in model.elems)
    node_points = OrderedDict((n.ind, n.pos) for n in model.nodes)
#    ground_nodes = {s.node_ind for s in model.supports}
    ground_nodes = set()
    for k_supp in model.supports:
        for k_g in grounded_supports:
#            print(k_supp.position.DistanceTo(k_g.position))
            if k_supp.position.DistanceTo(k_g.position) < 1e-4:
              ground_nodes.add(k_supp.node_ind)
    return element_from_id, node_points, ground_nodes

def get_id_from_element_from_model(model):
    return {tuple(e.node_inds) : e.ind for e in model.elems}

def nodes_from_elements(elements):
    return {n for e in elements for n in e}

def adjacent_from_edges(edges):
    """get a dict for graph connectivity {node_id : neighnor node ids}
    Parameters
    ----------
    edges : a list of 2-int-tuples
        [(node_1, node_2), ...]
    Returns
    -------
    undirected_edges : dict
        {node_id : neighnor node ids}
    """
    undirected_edges = defaultdict(set)
    for v1, v2 in edges:
        undirected_edges[v1].add(v2)
        undirected_edges[v2].add(v1)
    return undirected_edges

def get_distance(p1, p2):
    return math.sqrt(sum([(p1[i]-p2[i])**2 for i in range(3)]))

def incoming_from_edges(edges, element_from_id=None):
    incoming_vertices = defaultdict(set)
    for v1, v2 in edges:
        if element_from_id is None:
            incoming_vertices[v2].add(v1)
        else:
            incoming_vertices[element_from_id[v2]].add(element_from_id[v1])
    return incoming_vertices

##################################################

Node = namedtuple('Node', ['edge', 'vertex', 'cost'])

def dijkstra(source_vertices, successor_fn, cost_fn=lambda v1, v2: 1):
    node_from_vertex = {}
    queue = []
    for vertex in source_vertices:
        cost = 0
        node_from_vertex[vertex] = Node(None, None, cost)
        heapq.heappush(queue, (cost, vertex))
    while queue:
        cost1, vertex1 = heapq.heappop(queue)
        if node_from_vertex[vertex1].cost < cost1:
            continue
        for vertex2 in successor_fn(vertex1):
            edge = (vertex1, vertex2)
            cost2 = cost1 + cost_fn(*edge)
            if (vertex2 not in node_from_vertex) or (cost2 < node_from_vertex[vertex2].cost):
                node_from_vertex[vertex2] = Node(edge, vertex1, cost2)
                heapq.heappush(queue, (cost2, vertex2))
    return node_from_vertex

def compute_distance_from_node(elements, node_points, ground_nodes):
    nodes = nodes_from_elements(elements)
    neighbors = adjacent_from_edges(elements)
    edge_costs = {edge: get_distance(node_points[edge[0]], node_points[edge[1]])
                  for edge in elements}
    #edge_costs = {edge: np.abs(node_points[edge[1]] - node_points[edge[0]])[2]
    #              for edge in elements}
    edge_costs.update({edge[::-1]: distance for edge, distance in edge_costs.items()})
    successor_fn = lambda v: neighbors[v]
    cost_fn = lambda v1, v2: edge_costs[v1, v2] # TODO: z on cost function
    return dijkstra(ground_nodes & nodes, successor_fn, cost_fn)

#####################################

def retrace_sequence(visited, current_state, horizon=INF):
    (element, physical_behavior), prev_state = visited[current_state]
    if (prev_state is None) or (horizon == 0):
        # tracing reaches the end
        return []
    previous_elements = retrace_sequence(visited, prev_state, horizon=horizon-1)
    return previous_elements + [(element, physical_behavior)]

def get_sequence_from_plan(plan):
    return [p[0] for p in plan]

#####################################

def reverse_element(element):
    # element: int tuple
    return element[::-1]

def get_directions(element):
    return {element, reverse_element(element)}

def compute_candidate_elements(all_elements, ground_nodes, built_elements, use_two_link_prune=use_two_link_prune):
    # connectivity constraint is enforced here
    # enforce two link constraint
    elements_from_node = get_node_neighbors(built_elements)
    nodes = compute_printed_nodes(ground_nodes, built_elements)
    for element in set(all_elements) - built_elements:
        node1, node2 = element
        if (node1 not in nodes) and (node2 not in nodes):
            # element floating
            continue
        if not use_two_link_prune:
            yield element
        else:
            prev_element_node = None
            if not ((node1 in nodes) and (node2 in nodes)):
                if node1 in nodes:
                    # if existing node is not grounded and is degree-one before adding the new element
                    # aka a two-link cantilever
                    if node1 not in ground_nodes and len(elements_from_node[node1]) == 1:
                        prev_element_node = get_other_node(node1, list(elements_from_node[node1])[0])
                        if prev_element_node not in ground_nodes:
                            continue
                else:
                    # node2 in nodes
                    if node2 not in ground_nodes and len(elements_from_node[node2]) == 1:
                        prev_element_node = get_other_node(node2, list(elements_from_node[node2])[0])
                        if prev_element_node not in ground_nodes:
                            continue
            yield element

def compute_printed_nodes(ground_nodes, printed):
    return nodes_from_elements(printed) | set(ground_nodes)

def nodes_from_elements(elements):
    return {n for e in elements for n in e}

def is_reversed(all_elements, element):
    assert (element in all_elements) != (reverse_element(element) in all_elements)
    return element not in all_elements

def get_undirected(all_elements, directed):
    is_reverse = is_reversed(all_elements, directed)
    assert (directed in all_elements) != is_reverse
    return reverse_element(directed) if is_reverse else directed

def get_id_from_element(element_from_id):
    return {e: i for i, e in element_from_id.items()}

def get_extructed_ids(element_from_id, directed_elements):
    id_from_element = get_id_from_element(element_from_id)
    extruded_ids = []
    for directed in directed_elements:
        element = get_undirected(id_from_element, directed)
        extruded_ids.append(id_from_element[element])
    return sorted(extruded_ids)

def get_other_node(node1, element):
    assert node1 in element
    return element[node1 == element[0]]

########################################

def check_connected(ground_nodes, seq_built_elements):
    if not seq_built_elements:
        return True
    built_elements = set(seq_built_elements)
    node_neighbors = get_node_neighbors(built_elements)
    queue = deque(ground_nodes)
    visited_nodes = set(ground_nodes)
    visited_elements = set()
    while queue:
        node1 = queue.popleft()
        for element in node_neighbors[node1]:
            visited_elements.add(element)
            node2 = get_other_node(node1, element)
            if node2 not in visited_nodes:
                queue.append(node2)
                visited_nodes.add(node2)
    return built_elements <= visited_elements

def get_node_neighbors(elements):
    node_neighbors = defaultdict(set)
    for e in elements:
        n1, n2 = e
        node_neighbors[n1].add(e)
        node_neighbors[n2].add(e)
    return node_neighbors

def compute_z_distance(node_points, element):
    # Distance to a ground plane
    # Opposing gravitational force
    return get_midpoint(node_points, element)[2]

def get_midpoint(node_points, element):
    n1, n2 = element
    p1 = node_points[n1]
    p2 = node_points[n2]
    return [(p1[i]+p2[i])/2 for i in range(3)]

#######################################

def get_search_heuristic_fn(element_from_id, node_points, ground_nodes, heuristic='random', forward=True):
    sign = +1 if forward else -1
    all_elements = frozenset(element_from_id.values())
    distance_from_node = compute_distance_from_node(all_elements, node_points, ground_nodes)
    def h_fn(built_elements, element):
        # lower bias will be dequed first
        if heuristic == 'random':
            return random.random()
        elif heuristic == 'z_distance':
            return sign*compute_z_distance(node_points, element)
        elif heuristic == 'graph_distance':
            node_costs = [distance_from_node[node].cost for node in element]
            return sign*(node_costs[0]+node_costs[1])/2
        raise NotImplementedError('Search heuristic ({}) not implemented, the only available ones are: {}'.format(
            heuristic, SEARCH_HEURISTIC))
    return h_fn

def add_successors(queue, all_elements, grounded_nodes, heuristic_fn, ordered_built_elements, 
        incoming_from_element=None, verbose=False, solutions=[], violated_states=[], random_tiebreak=False):
    built_elements = set(ordered_built_elements)
    remaining = all_elements - built_elements
    num_remaining = len(remaining) - 1
    assert 0 <= num_remaining, 'num_remaining {}'.format(num_remaining)
    candidate_elements = list(compute_candidate_elements(all_elements, grounded_nodes, built_elements))
    # TODO make incoming_from_element safe
    for directed in candidate_elements: #randomize(candidate_elements):
        element = get_undirected(all_elements, directed)
        # partial ordering
        if not (incoming_from_element[element] <= built_elements):
            continue
        # compute bias value
        if len(solutions) == 0:
            bias = heuristic_fn(built_elements, element)
        else:
            # deflation-like objective
            new_ordered_built_elements = ordered_built_elements + (element,)
            similarity_score = 0
            for _, prev_plan in solutions:
                prev_seq = get_sequence_from_plan(prev_plan)
                for q_i, q_e in enumerate(new_ordered_built_elements):
                    similarity_score += abs(q_i - prev_seq.index(q_e))
            similarity_score *= -1.0
            bias = similarity_score
        # `num_remaining` can be seen as the search node's "inverse" depth in the search tree
        # heapq will prioritize poping ones with lower num_remaining value first, 
        # which means the node is on a deeper lever of the search tree
        if not random_tiebreak:
            priority = (num_remaining, bias)
        else:
            priority = (num_remaining, bias, random.random())
        heapq.heappush(queue, (0, priority, ordered_built_elements, element))

SearchState = namedtuple('SearchState', ['action', 'state'])

def progression_sequencing(model, grounded_supports, heuristic='z_distance', 
        stiffness=True, physical_tol=DEFAULT_PHYSICAL_TOL, 
        partial_orders=None, verbose=False, backtrack_limit=INF, max_time=INF, diversity=False):
    start_time = time.time()
    ## * prepare data
    element_from_id, node_points, ground_nodes = load_model(model, grounded_supports)
    id_from_element = get_id_from_element_from_model(model)
    all_elements = frozenset(element_from_id.values())
    assert len(ground_nodes) > 0, "Number of marked grounded nodes is zero! Check inputs."
    heuristic_fn = get_search_heuristic_fn(element_from_id, node_points, ground_nodes, heuristic=heuristic)
    
    ## * initial state
    initial_built = ()
    queue = []
    # visited keeps track of search history, maps () : SearchState
    visited = {initial_built : SearchState((None, None), None)}
    # TODO: check connectivity and stiffness for initial state
    # add candidate states from the initial state to the queue
    incoming_from_element = incoming_from_edges(partial_orders, element_from_id)
    add_successors(queue, all_elements, ground_nodes, heuristic_fn, initial_built, 
        incoming_from_element=incoming_from_element, verbose=verbose)
    
    plan = None
    min_remaining = len(element_from_id)
    num_evaluated = max_backtrack = stiffness_failures = 0
    cached_analysis = {}
    
    # * main search queue
    best_solution_score = 1e8
    solutions = []
    while queue and (time.time() - start_time < max_time) :
        level, bias, built_elements, element = heapq.heappop(queue)
        num_remaining = len(all_elements) - len(built_elements)        
        num_evaluated += 1
        if num_remaining < min_remaining:
            min_remaining = num_remaining
        
        backtrack = num_remaining - min_remaining
        if backtrack > max_backtrack:
            max_backtrack = backtrack
        if backtrack_limit < backtrack:
            print("Backtrack limit reached!")
            break
        
        if verbose:
            print('Iteration: {} | Min Remain: {} | Built: {}/{} | Level: {} | PrevBuilt: {} | Element: {} | Backtrack: {} | Stiffness failures: {} | Time: {:.3f}'.format(
                num_evaluated, min_remaining, len(built_elements), len(all_elements), 
                level, [id_from_element[e] for e in built_elements], id_from_element[element], 
                backtrack, stiffness_failures, elapsed_time(start_time)))
        
        # we keep `built_elements` as an ordered set
        assert element not in built_elements
        next_built_elements = built_elements + (element,)
        
        # * check constraint
        if len(solutions) > 0 and (next_built_elements in visited):
            if verbose: print('State visited before: {}'.format(next_built_elements))
            continue
        
        # no need to check connectivity here since the stiffness check should be able to capture that
        # assert check_connected(ground_nodes, next_built_elements)
        max_displacement = INF
        if stiffness:
            built_element_set = frozenset(next_built_elements)
            if built_element_set not in cached_analysis:
                existing_e_ids = get_extructed_ids(element_from_id, next_built_elements)
                physical_behavior = test_stiffness_fn(model, existing_e_ids, verbose=verbose)
                cached_analysis[built_element_set] = physical_behavior
            else:
                if verbose: print('reuse analysis!')
                physical_behavior = cached_analysis[built_element_set]
            chosen_metric = physical_behavior[0] if constraint == 'displacement' else physical_behavior[1]
            if chosen_metric > physical_tol:
                # the stiffness constraint is violated
                if verbose:
                    print("Stiffness constraint violated: max val {:.4f} | tol {:.4f}".format(
                    chosen_metric, physical_tol))
                stiffness_failures += 1
                continue
        
            # check if max_displacement is bigger than the best score, we skip
            if diversity and chosen_metric > best_solution_score:
                continue
        
        # * record history: SearchState(action, current state)
        visited[next_built_elements] = SearchState((element, physical_behavior), built_elements)
        if all_elements <= set(next_built_elements):
            min_remaining = 0
            # a solution has been found!
            plan = retrace_sequence(visited, next_built_elements)
            seq = get_sequence_from_plan(plan)
            new_path_cost = compute_path_cost_fn(plan)
            if not diversity:
                # if not doing diversity search, exit once a plan is found
                heapq.heappush(solutions, (new_path_cost, plan))
                break
            else:
                # check duplicated plan
                duplicated_plan = False
                for _, prev_plan in solutions:
                    if get_sequence_from_plan(prev_plan) == seq:
                        print('> Plan found before.') #.format([id_from_element[e] for e in seq]))
                        duplicated_plan = True
                        break
                assert not duplicated_plan, 'diversity search found a duplicated plan!'
                
                if new_path_cost <= best_solution_score*(1+1e-6):
                    print('!!! score {:.6f} | #of sols: {}| runtime {:.3f}| better plan found.'.format(
                        new_path_cost, len(solutions), elapsed_time(start_time)))
                    best_solution_score = new_path_cost
                    heapq.heappush(solutions, (new_path_cost, plan))
                else:
                    print('? score {:.6f} | #of sols: {}| runtime {:.3f} | not a better plan found.'.format(
                        new_path_cost, len(solutions), elapsed_time(start_time)))
                # clear the queue and restart the search
                queue = []
                visited = {initial_built : SearchState((None, None), None)}
                add_successors(queue, all_elements, ground_nodes, heuristic_fn, initial_built, 
                    incoming_from_element=incoming_from_element, verbose=verbose, solutions=solutions)
                continue
                
        # * continue to the next search level, add candidates to queue
        add_successors(queue, all_elements, ground_nodes, heuristic_fn, next_built_elements, 
            incoming_from_element=incoming_from_element, verbose=verbose, solutions=solutions)
    
    search_info = {
        'diversity' : diversity,
        'planning_time' : elapsed_time(start_time),
        'num_evaluated': num_evaluated,
        'min_remaining': min_remaining,
        'max_backtrack': max_backtrack,
        'stiffness_failures': stiffness_failures,
    }
    seq_solutions = []
    for sol_score, e_path in solutions:
        seq = [ep[0] for ep in e_path]
        phys_perf = [list(ep[1]) for ep in e_path]
        seq_solutions.append(SeqSolution(seq, phys_perf, sol_score, id_from_element))
    seq_sol_bundle = SeqSolutionBundle(seq_solutions, search_info)
    return seq_sol_bundle

############################
# main

num_elements = Model_in.elems
if enable:
    model = Model_in
    # clone the model and its list of elements to avoid side effects
    model = model.Clone()
    
    # partial order for hierarchical assembly
    _partial_orders = tree_to_list(partial_orders, lambda x:x) if partial_orders.DataCount > 0 else []
    
    queue = deque([(0.0, physical_tol)])
    iter_solutions = []
    best_solutions = None
    assert optimize_method in OPTIMIZE_METHODS
    
    if optimize_method == 'iterative_feasible_search':
        assert objective == constraint, "the optimal search only works when the objective and constraint are the same!"
        while queue:
            lower, higher = queue.popleft()
            if lower > higher:
                continue
            if abs(higher-lower) < iter_search_eps:
                print('({}, {}), search tol converge under {}'.format(lower, higher, iter_search_eps))
                break
            
            half_tol = (lower + higher) / 2.
            print('Interval ({}, {}): testing tol {}'.format(lower, higher, half_tol))
            iter_i_seq_sol_bundle = progression_sequencing(model, grounded_supports, 
                heuristic=heuristic, physical_tol=half_tol,
                stiffness=check_stiffness, verbose=verbose, max_time=max_time, 
                partial_orders=_partial_orders, 
                diversity=optimize_method=='diversity_search')
            
            print('plan cost {} | search time {:.2f}'.format(
                iter_i_seq_sol_bundle.min_cost, iter_i_seq_sol_bundle.search_info['planning_time']))
            print(iter_i_seq_sol_bundle.search_info)
            iter_solutions.append(iter_i_seq_sol_bundle)
    
            if len(iter_i_seq_sol_bundle.solutions) == 0:
                # no solution found, tol too small, should relax
                queue.extend([
                    (half_tol, higher),
                ])
            else:
                # solution found
                if best_solutions is None:
                    # the first found solution
                    best_solutions = iter_i_seq_sol_bundle
                if best_solutions is not None and \
                    iter_i_seq_sol_bundle.best_solution.cost < best_solutions.best_solution.cost:
                    # update best solution
                    best_solutions = iter_i_seq_sol_bundle
                queue.extend([
                    (lower, half_tol),
                ])
    else:
        iter_i_seq_sol_bundle = progression_sequencing(model, grounded_supports, 
            heuristic=heuristic, physical_tol=physical_tol,
            stiffness=check_stiffness, verbose=verbose, max_time=max_time, 
            partial_orders=_partial_orders, 
            diversity=optimize_method=='diversity_search')
        iter_solutions.append(iter_i_seq_sol_bundle)
        if len(iter_i_seq_sol_bundle.solutions) > 0:
            best_solutions = iter_i_seq_sol_bundle
    
    solution_bundles = None
    if best_solutions is not None:
        solution_bundles = [isol for isol in iter_solutions if isol.feasible_found]
        print('{} feasible plans found!'.format(len(solution_bundles))) 
        print('Min solution cost: {}'.format(best_solutions.min_cost))
    else:
        print('No plan found with time limit {}, tolerance {}.'.format(
            max_time, physical_tol))
    
    # save no matter a solution is found or not
    if save_solutions:
        data_dict = {
            'solution_bundles' : [iter_sol_bundle.to_data() for iter_sol_bundle in iter_solutions],
        }
        with open(save_path, 'w') as fp:
            json.dump(data_dict, fp)
        print('Solutions saved to {}'.format(save_path))
else:
    # parse solutions only
    with open(save_path, 'r') as fp:
        data_dict = json.load(fp)
        solution_bundles = [SeqSolutionBundle.from_data(sbd) for sbd in data_dict['solution_bundles']]
        print('Solution bundles parsed from {}'.format(save_path))
        print solution_bundles

if solution_bundles is not None:
    # keep only the feasible ones, sort by costs
    feasible_bundles = [isol for isol in solution_bundles if isol.feasible_found]
    solution_bundles = sorted(feasible_bundles, key=lambda y: y.min_cost)
# ---------- end progression_search_algorithm ----------
returned_search_info = Panel(progression_search_algorithm.out)
data = Data(progression_search_algorithm.solution_bundles)

# ---- group: set num of solutions range (continued)
list_length_6 = ListLength(List=data)
subtraction_4 = Subtraction(A=list_length_6, B=1)
construct_domain_2 = ConstructDomain(DomainStart="0", DomainEnd=subtraction_4)
set_slider_properties_2 = SetSliderProperties(Slider=get_connected_objects_2, Range=construct_domain_2)

# ----
# Each planning call will returns a solution bundle, which contains one or multiple plans.
# When using iterative feasible search, multiple solution bundles will be returned.
ghpython_script_10 = GhPythonScript(solution_bundles=data, sol_bundle_idx=solution_bundle_index, plan_idx=plan_index)  # -> out, sequence, displacement_per_step, stress_per_step, plan_cost, all_plan_costs; inputs solution_bundles: list, sol_bundle_idx: Int32, plan_idx: Int32
# ---------- ghpython_script_10: Python ----------
from ghpythonlib.treehelpers import list_to_tree, tree_to_list

###########################################

all_plan_costs = []
for sb in solution_bundles:
    all_plan_costs.extend(sb.costs)

chosen_sol_bundle = solution_bundles[sol_bundle_idx]
assert chosen_sol_bundle.feasible_found, "no feasible solution found in solution bundle!"

num_plans = len(chosen_sol_bundle.solutions)
assert plan_idx >=0 and plan_idx < num_plans, \
    'solution bundle only contains {} plans'.format(num_plans)
sorted_solution = chosen_sol_bundle.sorted_solutions
chosen_solution = sorted_solution[plan_idx]

sequence = chosen_solution.seq
displacement_per_step =  [p[0] for p in chosen_solution.stepwise_physics_performance]
stress_per_step =  [p[1] for p in chosen_solution.stepwise_physics_performance]
plan_cost = chosen_solution.cost

#solutions = sorted(solutions, key=lambda path: compute_path_cost_fn(path))
#
#if len(solutions) > 0:
#    plan = solutions[sol_idx]
#    plan_cost = compute_path_cost_fn(plan)
#    
#    plan = [[e, max_disp] for (e, max_disp) in plan]
#    plan = list_to_tree(plan, source=[])
#else:
#    plan = None
#    plan_cost = 1e3
# ---------- end ghpython_script_10 ----------

# ---- group: max stress per step
number_6 = Number(flatten(ghpython_script_10.stress_per_step))

# ---- group: plan!
integer_8 = Integer(flatten(ghpython_script_10.sequence))

# ---- group: set sequence stepper range
tree_statistics_2 = TreeStatistics(Tree=integer_8)  # -> Paths, Length, Count
construct_domain_3 = ConstructDomain(DomainStart="1", DomainEnd=tree_statistics_2.Length)
set_slider_properties_3 = SetSliderProperties(Slider=get_connected_objects, Range=construct_domain_3)

# ---- group: max_displacement for each step of the plan
number_7 = Number(flatten(ghpython_script_10.displacement_per_step))

# ---- group: max displacement
quick_graph = QuickGraph(number_7, SortOrder=0)

# ---- group: max stress
quick_graph_2 = QuickGraph(number_6, SortOrder=0)

# ---- group: plan cost distributions of all found plans (combining all bundles)
bar_graph_2 = BarGraph(ghpython_script_10.all_plan_costs, BarColor=RGB(255, 0, 90))

# ----
panel_45 = Panel(integer_8)
split_list_2 = SplitList(List=integer_8, Index=sequence_step)  # -> ListA, ListB

# ---- group: color coded seq viz (continued)
integer_9 = Integer(split_list_2.ListA)
list_length_7 = ListLength(List=integer_9)
split_list_3 = SplitList(List=colour, Index=list_length_7)  # -> ListA, ListB
list_item_8 = ListItem(List=pipe, Index=integer_9, Wrap=True)
custom_preview = CustomPreview(Geometry=list_item_8, Material=split_list_3.ListA)

# ---- group: fea score each step
number_8 = Number(flatten(number_7))

# ---- group: plan cost
number_9 = Number(ghpython_script_10.plan_cost)

# ---- group: For making a gif of the sequence (continued)
integer_10 = Integer(tree_statistics_2.Length)
series_2 = Series(Start="1", Step=1, Count=integer_10)  # -> simplify(graft(Series))
capture = Capture(
    Variables=sequence_step,
    Mode=1,
    Properties=0,
    DesignMap=series_2,
    CsvDirectory="None",
    ScreenshotFilename=panel_32,
    ScreenshotDirectory=pathmaker_2.a,
    BackupFrequency=0)  # -> DesignMapObjectives, CapturedProperties, Data, Images

# ----
integer_11 = Integer(integer_8)
ghpython_script_11 = GhPythonScript(
    enable=compute_fea_for_seq,
    model_in=model_karamba3d_3,
    stiffness_fn=ghpython_script_4.test_stiffness_fn,
    seq=integer_11,
    use_stress_constraint=boolean)  # -> out, stress_history, displacement_history; inputs seq: list, parsed_history: list
# ---------- ghpython_script_11: Python ----------
if enable:
    model = model_in.Clone()
    
    stress_history = []
    displacement_history = []
    
    for i in range(len(seq)):
        built = seq[:i+1]
        max_displacement, max_sigma = stiffness_fn(model, built)
        displacement_history.append(max_displacement)
        stress_history.append(max_sigma)
    
    to_compare_history = stress_history if use_stress_constraint \
        else displacement_history
    
    if parsed_history is not None:
        for a, b in zip(parsed_history, to_compare_history):
            assert abs(a-b) < 1e-6, 'deviation {}'.format(abs(a-b))
# ---------- end ghpython_script_11 ----------
multiplication_7 = Multiplication(A=ghpython_script_11.stress_history, B=10)
list_item_9 = ListItem(List=multiplication_7, Index=sequence_step, Wrap=True)
panel_46 = Panel(multiplication_7)

# ---- group: design map
number_10 = Number(number_5)

# ---- group: stress
quick_graph_3 = QuickGraph(multiplication_7, SortOrder=0)

# ----
ghpython_script_12 = GhPythonScript(
    save=save_fig,
    restart=restart,
    data_path=file_path_6,
    test_folder_name=text_6,
    design_id=integer_7,
    seq_id=integer_2,
    seq=integer_11,
    stress_history=ghpython_script_11.stress_history,
    displacement_history=ghpython_script_11.displacement_history,
    black_background=black_background)  # -> out, simplify(colors); inputs save: Boolean, design_id: Int32, seq_id: Int32, seq: list of Int32, stress_history: list, displacement_history: list, black_background: Boolean
# ---------- ghpython_script_12: Python ----------
from itertools import combinations

import System
import Grasshopper.Kernel.Data.GH_Path as ghpath
import Grasshopper.DataTree as datatree

from ghpythonlib.treehelpers import list_to_tree, tree_to_list

assert len(stress_history)>100
if save:
    from compas.rpc import Proxy
    with Proxy('seq_dse.visualization') as cp_v: #, python='python', capture_output=False)
        if restart:
            cp_v.restart_server()
        cp_v.save_seq_performance_plot(data_path, test_folder_name, design_id or 0, seq_id,
         seq, stress_history, displacement_history, black_background=black_background)
# ---------- end ghpython_script_12 ----------
list_length_8 = ListLength(List=integer_8)
multiplication_8 = Multiplication(A=ghpython_script_11.displacement_history, B=100)
list_item_10 = ListItem(List=multiplication_8, Index=sequence_step, Wrap=True)

# ---- group: displacement
quick_graph_4 = QuickGraph(multiplication_8, SortOrder=0)

# ----
multiplication_9 = Multiplication(A=list_length_8, B=series, C="0.01")
sort_list_4 = SortList(Keys=ghpython_script_11.stress_history)  # -> Keys, ValuesValuesA
panel_47 = Panel(ghpython_script_12.out)
sort_list_5 = SortList(Keys=ghpython_script_11.displacement_history)  # -> Keys, ValuesValuesA
integer_12 = Integer(multiplication_9)
panel_48 = Panel(integer_12)
panel_49 = Panel(list_item_9)
panel_50 = Panel(list_item_10)
list_item_11 = ListItem(List=sort_list_4.Keys, Index=0, Wrap=True)  # -> Item1, Item
list_item_12 = ListItem(List=sort_list_5.Keys, Index=0, Wrap=True)  # -> Item1, Item
number_11 = Number([list_item_12.Item1, list_item_12.Item])
panel_51 = Panel([list_item_12.Item1, list_item_12.Item])
panel_52 = Panel(number_11)
data_recorder = DataRecorder(number_11, DataLimit=-10, RecordData=True)
panel_53 = Panel(data_recorder)

# ---- group: Visualize partial structure
list_length_9 = ListLength(List=integer_8)
integer_13 = Integer(list_length_9)

# ---- group: Visualize partial structure / convert element ids to a Boolean list
turn_sequence_into_element_activations = GhPythonScript(nE=integer_13, elem_ids=split_list_2.ListA)  # -> out, flatten(element_activation); inputs nE: Int32, elem_ids: list of Int32
# ---------- turn_sequence_into_element_activations: Python ----------
import rhinoscriptsyntax as rs
import Rhino.Geometry.Plane as Plane
import Rhino.Geometry.Point3d as Point3d
import Rhino.Geometry.Vector3d as Vector3d
import Rhino.Geometry.Quaternion as Quat
import Grasshopper.DataTree as DataTree # Add, AddRange(list, GHPath(i, j))
import Grasshopper.Kernel.Data.GH_Path as GHPath
import System

from ghpythonlib.treehelpers import list_to_tree, tree_to_list

element_activation = [False for i in range(nE)]
for e in elem_ids:
    element_activation[e] = True
# ---------- end turn_sequence_into_element_activations ----------

# ---- group: Visualize partial structure
element_activation_karamba3d = ElementActivationKaramba3D(Model=model_karamba3d_3, IsActive=turn_sequence_into_element_activations.element_activation)
analyze_karamba3d_3 = AnalyzeKaramba3D(Model=element_activation_karamba3d)  # -> CalculatedModel, MaximumDisplacement_cm, ResultingForceOfGravity_kN, ElasticEnergy_kNm
panel_54 = Panel(analyze_karamba3d_3.MaximumDisplacement_cm)

model_view_karamba3d_2 = ModelViewKaramba3D(Model=analyze_karamba3d_3.CalculatedModel, ResultFactors=1, ResultCase=-1)  # -> Model, DeformedMesh, DeformedAxes, DeformedModel
beam_view_karamba3d_2 = BeamViewKaramba3D(Model=model_view_karamba3d_2.Model)  # -> Model, MeshesOfRenderedBeams, DeformedBeamAxes, LegendColors, LegendTags
offset_mesh = OffsetMesh(Mesh=beam_view_karamba3d_2.MeshesOfRenderedBeams, Distance=Slider(0.01, range=0..1), BothSides=False, CreateSolid=True)  # disabled
legend_2 = Legend(Colour=beam_view_karamba3d_2.LegendColors, Tags=beam_view_karamba3d_2.LegendTags, LegendType=1)

# ----
number_12 = Number(number_9)

# ---- group: seq cost
number_13 = Number(flatten(number_12))

# ----
merge_4 = Merge(Data1=number_13, Data2=number_4, Data3=integer_3)  # -> flatten(Result)
panel_55 = Panel(merge_4)

capture_2 = Capture(
    Variables=design_id,
    Objectives=merge_4,
    Mode=0,
    Properties=merge_3,
    DesignMap=number_10,
    CsvFilename="samples",
    CsvDirectory=text_4,
    ScreenshotFilename="samples",
    ScreenshotDirectory=text_4,
    BackupFrequency="3")  # -> DesignMapObjectives, CapturedProperties, Data, Images

panel_56 = Panel(capture_2.Data)
panel_57 = Panel(capture_2.CapturedProperties)
panel_58 = Panel(capture_2.Images)
panel_59 = Panel(capture_2.DesignMapObjectives)

# ==== cluster BoundingBoxDimension: BoundingBox Dimension
content = ClusterInput()
bounding_box = BoundingBox(Content=content, Plane=PlaneXY(0, 0, 0), UnionBox=True)  # -> Box, Box_2
deconstruct_box = DeconstructBox(Box=bounding_box.Box)  # -> Plane, X, Y, Z
deconstruct_domain = DeconstructDomain(Domain=deconstruct_box.X)  # -> Start, End
deconstruct_domain_2 = DeconstructDomain(Domain=deconstruct_box.Y)  # -> Start, End
deconstruct_domain_3 = DeconstructDomain(Domain=deconstruct_box.Z)  # -> Start, End
subtraction = Subtraction(A=deconstruct_domain.End, B=deconstruct_domain.Start)
subtraction_2 = Subtraction(A=deconstruct_domain_2.End, B=deconstruct_domain_2.Start)
subtraction_3 = Subtraction(A=deconstruct_domain_3.End, B=deconstruct_domain_3.Start)
result = ClusterOutput(subtraction)
result_2 = ClusterOutput(subtraction_2)
result_3 = ClusterOutput(subtraction_3)
